# Grasshopper definition Pixelglasses - By DyvikDesign - WIP.gh (Grasshopper 0.9.14)

pixel_frame_thickness = Slider(0.3, range=0.1..1.3)
opacity_of_glasses = Slider(0.3, range=0..1)
frame_width_factor = Slider(1.4, range=0.5..10)
arm_width_factor = Slider(1.4, range=1..10)
material_thickness = Slider(3, range=1..6)
symbol_position = Slider(0.575, range=0..1)
pressfit_comp = Slider(-0.06, range=-0.1..0.1)
glass_width = Slider(140, range=100..200)
arm_lenght = Slider(105, range=100..200)
# Design by DyvikDesign:
# 
# Creative Commons - Public Domain License
# Load outline curve of left half
# of glasses here:
_3d_preview = BooleanToggle(True)
glass_outline = Curve(<curve referenced from the Rhino model>)
pt = PointXYZ(XComponent=-1000000, YComponent=0, ZComponent=0, System=PlaneXY(0, 0, 0))
pt_2 = PointXYZ(XComponent=1000000, YComponent=0, ZComponent=0, System=PlaneXY(0, 0, 0))
division = Division(A=glass_width, B=2)
crv_cp = CurveCP(Point=pt_2, Curve=glass_outline)  # -> Point, Parameter, Distance
crv_cp_2 = CurveCP(Point=pt, Curve=glass_outline)  # -> Point, Parameter, Distance
dist = Distance(PointA=crv_cp.Point, PointB=crv_cp_2.Point)
yz = YZPlane(Origin=crv_cp.Point)
mirror = Mirror(Geometry=glass_outline, Plane=yz)  # -> Geometry, Transform
division_2 = Division(A=division, B=dist)
join = JoinCurves(Curves=flatten([mirror.Geometry, glass_outline]), Preserve=False)
end = EndPoints(Curve=join)  # -> Start, End
ln = Line(StartPoint=end.Start, EndPoint=end.End)
join_2 = JoinCurves(Curves=flatten([join, ln]), Preserve=False)
pt_3 = PointXYZ(XComponent=0, YComponent=0, ZComponent=0, System=PlaneXY(0, 0, 0))
area = Area(Geometry=join_2)  # -> Area, Centroid
pt_4 = Point(pt_3)
vec2pt = Vector2Pt(PointA=area.Centroid, PointB=pt_4, Unitize=False)  # -> Vector, Length
move = Move(Geometry=join_2, Motion=vec2pt.Vector)  # -> Geometry, Transform
scale = Scale(Geometry=move.Geometry, Center=pt_4, Factor=division_2)  # -> Geometry, Transform
frame_outline = Curve(scale.Geometry)
bbox = BoundingBox(Content=frame_outline, Union=False, Plane=PlaneXY(0, 0, 0))  # -> Box, Box_2
edges = BrepEdges(Brep=bbox.Box)  # -> Naked, Interior, NonManifold
item = ListItem(List=edges.Naked, Index=1, Wrap=False)
addition = Addition(A=material_thickness, B=pixel_frame_thickness)
end_2 = EndPoints(Curve=item)  # -> Start, End
dist_2 = Distance(PointA=end_2.Start, PointB=end_2.End)
division_3 = Division(A=dist_2, B=addition)
division_4 = Division(A=glass_width, B=addition)
round = Round(Number=division_3)  # -> Nearest, Floor, Ceiling
round_2 = Round(Number=division_4)  # -> Nearest, Floor, Ceiling
xz = XZPlane(Origin=Point(0, 0, 0))
division_5 = Division(A=round_2.Ceiling, B=2)
multiplication = Multiplication(A=division_5, B=addition)
sqgrid = Square(Plane=xz, Size=addition, ExtentX=round_2.Ceiling, ExtentY=round.Ceiling)  # -> Cells, Points
pt_5 = PointXYZ(XComponent=multiplication, YComponent=0, ZComponent=0, System=PlaneXY(0, 0, 0))
neg = Negative(Value=addition)
multiplication_2 = Multiplication(A=addition, B=-1.5)
multiplication_3 = Multiplication(A=addition, B=1.55)
multiplication_4 = Multiplication(A=neg, B=2)
bbox_2 = BoundingBox(Content=flatten(sqgrid.Cells), Union=True, Plane=PlaneXY(0, 0, 0))  # -> Box, Box_2
xz_2 = XZPlane(Origin=pt_5)
dom = Domain(DomainStart=multiplication_4, DomainEnd=0)
dom_2 = Domain(DomainStart=multiplication_3, DomainEnd=multiplication_2)
area_2 = Area(Geometry=bbox_2.Box)  # -> Area, Centroid
vec2pt_2 = Vector2Pt(PointA=area_2.Centroid, PointB=pt_4, Unitize=False)  # -> Vector, Length
subtraction = Subtraction(A=material_thickness, B=pressfit_comp)
rectangle = Rectangle(Plane=xz_2, XSize=dom, YSize=dom_2, Radius=0)  # -> Rectangle, Length
division_6 = Division(A=addition, B=2)
move_2 = Move(Geometry=sqgrid.Points, Motion=vec2pt_2.Vector)  # -> Geometry, Transform
multiplication_5 = Multiplication(A=subtraction, B=-0.5)
multiplication_6 = Multiplication(A=subtraction, B=0.5)
yz_2 = YZPlane(Origin=Point(0, 0, 0))
move_3 = Move(Geometry=sqgrid.Cells, Motion=vec2pt_2.Vector)  # -> Geometry, Transform
multiplication_7 = Multiplication(A=addition, B=2)
X = UnitX(Factor=division_6)
Z = UnitZ(Factor=division_6)
multiplication_8 = Multiplication(A=round.Ceiling, B=addition)
mirror_2 = Mirror(Geometry=rectangle.Rectangle, Plane=yz_2)  # -> Geometry, Transform
neg_2 = Negative(Value=multiplication_7)
move_4 = Move(Geometry=move_2.Geometry, Motion=X)  # -> Geometry, Transform
runion = RegionUnion(Curves=flatten([rectangle.Rectangle, frame_outline, mirror_2.Geometry]))
dom_3 = Domain(DomainStart=0, DomainEnd=neg_2)
dom_4 = Domain(DomainStart=multiplication_6, DomainEnd=multiplication_5)
neg_3 = Negative(Value=multiplication_8)
num = Number(material_thickness)
arm_hook_length = Slider(6, range=2..6)
neg_4 = Negative(Value=addition)
move_5 = Move(Geometry=move_4.Geometry, Motion=Z)  # -> Geometry, Transform
multiplication_9 = Multiplication(A=num, B=1)
pt_6 = PointXYZ(XComponent=0, YComponent=0, ZComponent=neg_3, System=PlaneXY(0, 0, 0))
xz_3 = XZPlane(Origin=pt_6)
division_7 = Division(A=neg_4, B=2)
con = Containment(Point=move_5.Geometry, Curve=runion)  # -> Relationship, Point
neg_5 = Negative(Value=multiplication_9)
Z_2 = UnitZ(Factor=division_7)
rectangle_2 = Rectangle(Plane=xz_3, XSize=dom_3, YSize=dom_4, Radius=0)  # -> Rectangle, Length
Z_3 = UnitZ(Factor=neg_5)
subtraction_2 = Subtraction(A=con.Relationship, B=1)
multiplication_10 = Multiplication(A=num, B=arm_hook_length)
move_6 = Move(Geometry=pt_6, Motion=Z_3)  # -> Geometry, Transform
X_2 = UnitX(Factor=arm_lenght)
dispatch = Dispatch(List=move_3.Geometry, DispatchPattern=subtraction_2)  # -> ListA, ListB
dispatch_2 = Dispatch(List=move_5.Geometry, DispatchPattern=subtraction_2)  # -> ListA, ListB
neg_6 = Negative(Value=multiplication_10)
move_7 = Move(Geometry=rectangle_2.Rectangle, Motion=Z_2)  # -> Geometry, Transform
move_8 = Move(Geometry=pt_6, Motion=X_2)  # -> Geometry, Transform
Z_4 = UnitZ(Factor=neg_6)
X_3 = UnitX(Factor=multiplication_10)
move_9 = Move(Geometry=move_8.Geometry, Motion=Z_4)  # -> Geometry, Transform
move_10 = Move(Geometry=move_9.Geometry, Motion=X_3)  # -> Geometry, Transform
crv_cp_3 = CurveCP(Point=flatten(dispatch_2.ListB), Curve=runion)  # -> Point, Parameter, Distance
multiplication_11 = Multiplication(A=addition, B=frame_width_factor)
pline = PolyLine(Vertices=[move_6.Geometry, pt_6, move_8.Geometry, move_10.Geometry], Closed=False)
smaller = SmallerThan(FirstNumber=crv_cp_3.Distance, SecondNumber=multiplication_11)  # -> SmallerThan, OrEqualTo
division_8 = Division(A=multiplication_10, B=addition)
dispatch_3 = Dispatch(List=flatten(dispatch.ListB), DispatchPattern=smaller.SmallerThan)  # -> ListA, ListB
round_3 = Round(Number=division_8)  # -> Nearest, Floor, Ceiling
bbox_3 = BoundingBox(Content=pline, Union=False, Plane=PlaneXY(0, 0, 0))  # -> Box, Box_2
multiplication_12 = Multiplication(A=round_3.Floor, B=addition)
dim = Dimensions(Surface=bbox_3.Box)  # -> UDimension, VDimension
neg_7 = Negative(Value=multiplication_12)
glass_pixels = Curve(dispatch_3.ListB)
division_9 = Division(A=dim.UDimension, B=addition)
division_10 = Division(A=dim.VDimension, B=addition)
Z_5 = UnitZ(Factor=neg_7)
round_4 = Round(Number=division_9)  # -> Nearest, Floor, Ceiling
round_5 = Round(Number=division_10)  # -> Nearest, Floor, Ceiling
move_11 = Move(Geometry=pt_6, Motion=Z_5)  # -> Geometry, Transform
division_11 = Division(A=addition, B=2)
xz_4 = XZPlane(Origin=move_11.Geometry)
X_4 = UnitX(Factor=division_11)
Z_6 = UnitZ(Factor=division_11)
sqgrid_2 = Square(Plane=xz_4, Size=addition, ExtentX=round_4.Ceiling, ExtentY=round_5.Ceiling)  # -> Cells, Points
Z_7 = UnitZ(Factor=0.1)
move_12 = Move(Geometry=pt_5, Motion=Z_7)  # -> Geometry, Transform
move_13 = Move(Geometry=sqgrid_2.Points, Motion=X_4)  # -> Geometry, Transform
division_12 = Division(A=material_thickness, B=2)
multiplication_13 = Multiplication(A=division_12, B=opacity_of_glasses)
division_13 = Division(A=pixel_frame_thickness, B=2)
move_14 = Move(Geometry=move_13.Geometry, Motion=Z_6)  # -> Geometry, Transform
multiplication_14 = Multiplication(A=addition, B=arm_width_factor)
cp = ClosestPoint(Point=move_12.Geometry, Cloud=flatten(dispatch_2.ListB))  # -> ClosestPoint, CPIndex, Distance
neg_8 = Negative(Value=addition)
addition_2 = Addition(A=material_thickness, B=pressfit_comp)
crv_cp_4 = CurveCP(Point=move_14.Geometry, Curve=pline)  # -> Point, Parameter, Distance
X_5 = UnitX(Factor=neg_8)
addition_3 = Addition(A=division_13, B=multiplication_13)
smaller_2 = SmallerThan(FirstNumber=crv_cp_4.Distance, SecondNumber=multiplication_14)  # -> SmallerThan, OrEqualTo
multiplication_15 = Multiplication(A=addition_2, B=-0.5)
multiplication_16 = Multiplication(A=addition_2, B=0.5)
move_15 = Move(Geometry=cp.ClosestPoint, Motion=X_5)  # -> Geometry, Transform
neg_9 = Negative(Value=addition_3)
neg_10 = Negative(Value=division_13)
xz_5 = XZPlane(Origin=Point(0, 0, 0))
dom_5 = Domain(DomainStart=multiplication_16, DomainEnd=multiplication_15)
dispatch_4 = Dispatch(List=sqgrid_2.Cells, DispatchPattern=smaller_2.SmallerThan)  # -> ListA, ListB
xz_6 = XZPlane(Origin=move_15.Geometry)
runion_2 = RegionUnion(Curves=flatten(dispatch.ListB))
offset = Offset(Curve=flatten(dispatch.ListB), Distance=neg_10, Plane=xz_5, Corners=1)
offset_2 = Offset(Curve=glass_pixels, Distance=neg_9, Plane=xz_5, Corners=1)
rectangle_3 = Rectangle(Plane=xz_6, XSize=dom_5, YSize=dom_5, Radius=0)  # -> Rectangle, Length
yz_3 = YZPlane(Origin=Point(0, 0, 0))
mirror_3 = Mirror(Geometry=rectangle_3.Rectangle, Plane=yz_3)  # -> Geometry, Transform
runion_3 = RegionUnion(Curves=flatten([move_7.Geometry, dispatch_4.ListA]))
offset_3 = Offset(Curve=flatten(dispatch_4.ListA), Distance=neg_10, Plane=xz_5, Corners=1)
pixel_frame_engrave_front = Curve([offset, runion_2])
armature_holes = Curve([mirror_3.Geometry, rectangle_3.Rectangle])
frame_outline_2 = Curve(runion_2)
lens_cutouts = Curve(offset_2)
pixel_frame_engrave_arm = Curve(offset_3)
arm_cutting_line = Curve(runion_3)
multiplication_17 = Multiplication(A=round.Ceiling, B=addition)
multiplication_18 = Multiplication(A=multiplication_17, B=Slider(1.818, range=0..4))
multiplication_19 = Multiplication(A=material_thickness, B=3)
neg_11 = Negative(Value=multiplication_18)
neg_12 = Negative(Value=multiplication_19)
pt_7 = PointXYZ(XComponent=neg_12, YComponent=0, ZComponent=0, System=PlaneXY(0, 0, 0))
yz_4 = YZPlane(Origin=pt_7)
Z_8 = UnitZ(Factor=neg_11)
filter = StreamFilter(Gate=_3d_preview, Stream1=flatten([lens_cutouts, frame_outline_2]))
filter_2 = StreamFilter(Gate=_3d_preview, Stream1=flatten(arm_cutting_line))
move_16 = Move(Geometry=flatten([armature_holes, frame_outline_2, lens_cutouts]), Motion=Z_8)  # -> Geometry, Transform
mirror_4 = Mirror(Geometry=arm_cutting_line, Plane=yz_4)  # -> Geometry, Transform
mirror_5 = Mirror(Geometry=pixel_frame_engrave_arm, Plane=yz_4)  # -> Geometry, Transform
move_17 = Move(Geometry=flatten(pixel_frame_engrave_front), Motion=Z_8)  # -> Geometry, Transform
planar = PlanarSrf(Edges=filter)
Y = UnitY(Factor=material_thickness)
planar_2 = PlanarSrf(Edges=filter_2)
Y_2 = UnitY(Factor=material_thickness)
pt_8 = PointXYZ(XComponent=0, YComponent=0, ZComponent=neg_3, System=PlaneXY(0, 0, 0))
extr = Extrude(Base=planar, Direction=Y)
move_18 = Move(Geometry=pt_8, Motion=Z_2)  # -> Geometry, Transform
extr_2 = Extrude(Base=planar_2, Direction=Y_2)
yz_5 = YZPlane(Origin=move_18.Geometry)
yz_6 = YZPlane(Origin=move_18.Geometry)
pt_9 = PointXYZ(XComponent=0, YComponent=0, ZComponent=neg_3, System=PlaneXY(0, 0, 0))
orient = Orient(Geometry=flatten(pixel_frame_engrave_arm), Source=yz_5, Target=xz_6)  # -> Geometry, Transform
orient_2 = Orient(Geometry=extr_2, Source=yz_6, Target=xz_6)  # -> Geometry, Transform
xz_7 = XZPlane(Origin=Point(0, 0, 0))
xy = XYPlane(Origin=pt_9)
mirror_6 = Mirror(Geometry=orient.Geometry, Plane=xz_6)  # -> Geometry, Transform
multiplication_20 = Multiplication(A=material_thickness, B=0.5)
mirror_7 = Mirror(Geometry=orient_2.Geometry, Plane=xz_6)  # -> Geometry, Transform
Y_3 = UnitY(Factor=material_thickness)
orient_3 = Orient(Geometry=flatten([move_16.Geometry, mirror_4.Geometry, arm_cutting_line]), Source=xz_7, Target=xy)  # -> Geometry, Transform
orient_4 = Orient(Geometry=flatten([move_17.Geometry, mirror_5.Geometry, pixel_frame_engrave_arm]), Source=xz_7, Target=xy)  # -> Geometry, Transform
move_19 = Move(Geometry=mirror_7.Geometry, Motion=Y_3)  # -> Geometry, Transform
X_6 = UnitX(Factor=multiplication_20)
multiplication_21 = Multiplication(A=material_thickness, B=-0.5)
move_20 = Move(Geometry=mirror_6.Geometry, Motion=X_6)  # -> Geometry, Transform
Y_4 = UnitY(Factor=material_thickness)
X_7 = UnitX(Factor=multiplication_21)
move_21 = Move(Geometry=move_20.Geometry, Motion=Y_4)  # -> Geometry, Transform
yz_7 = YZPlane(Origin=Point(0, 0, 0))
move_22 = Move(Geometry=move_19.Geometry, Motion=X_7)  # -> Geometry, Transform
yz_8 = YZPlane(Origin=Point(0, 0, 0))
mirror_8 = Mirror(Geometry=move_21.Geometry, Plane=yz_7)  # -> Geometry, Transform
mirror_9 = Mirror(Geometry=move_22.Geometry, Plane=yz_8)  # -> Geometry, Transform

engraving_lines = Curve(orient_4.Geometry)
# BAKE THIS SHIT
cutting_lines = Curve(orient_3.Geometry)

filter_3 = StreamFilter(Gate=_3d_preview, Stream1=flatten([mirror_8.Geometry, move_21.Geometry, pixel_frame_engrave_front]))
filter_4 = StreamFilter(Gate=_3d_preview, Stream1=flatten([mirror_9.Geometry, extr, move_22.Geometry]))
engraving_preview = Curve(filter_3)
brep = Brep(filter_4)
material = CreateMaterial(Diffuse=RGB(58, 163, 189), Specular=RGB(255, 255, 255), Emission=RGB(0, 0, 0), Transparency=0, Shine=0)
material_2 = CreateMaterial(Diffuse=RGB(135, 231, 255), Specular=RGB(255, 255, 255), Emission=RGB(0, 0, 0), Transparency=0, Shine=0)
preview = CustomPreview(Geometry=engraving_preview, Shader=material_2)
preview_2 = CustomPreview(Geometry=brep, Shader=material)
